# Grasshopper definition WaveFunctionCollapse_test.gh (Grasshopper 1.0.4)
# plug-ins: WaveFunctionCollapse

surface = Surface(<surface referenced from the Rhino model>)
surface_2 = Surface([<surface referenced from the Rhino model> x12])
surface_3 = Surface([<surface referenced from the Rhino model> x4])
divide_surface = DivideSurface(Surface=surface, UCount=10, VCount=10)  # -> Points, Normals, Parameters
box_properties = BoxProperties(Box=surface_3)  # -> Center, Diagonal, Area, Volume, Degeneracy
box_properties_2 = BoxProperties(Box=surface_2)  # -> Center, Diagonal, Area, Volume, Degeneracy
custom_preview = CustomPreview(
    Geometry=box_properties_2.Center,
    Material={diffuse=RGB(221, 160, 221), emission=RGB(66, 48, 66), shine=0.5, specular=RGB(255, 255, 255), transparency=0})
c_script = CSharpScript()  # -> Out, A
custom_preview_2 = CustomPreview(
    Geometry=box_properties.Center,
    Material={diffuse=RGB(221, 160, 221), emission=RGB(66, 48, 66), shine=0.5, specular=RGB(255, 255, 255), transparency=0})
patterns_testtt = Patterns_testtt(TileTypeA=surface_3, TileTypeB=box_properties_2.Center)  # -> PatternFromSampleParameter, HalfTiles, FullTiles, EmptyTiles
wavefunctioncollapse = WaveFunctionCollapse(PatternFromSampleParameter=patterns_testtt.PatternFromSampleParameter)  # -> NumberOfRotatedTiles, PanelTexts, PatternHistoryParameter
surface_4 = Surface(<surface referenced from the Rhino model>)
visualise_by_history = VisualiseByHistory(
    WaveFunctionCollapsed=wavefunctioncollapse.PatternHistoryParameter,
    Timelapse=Slider(0.363, range=0..1),
    TILE01=surface_4,
    TILE02=surface_4,
    XWAVELOCATION=Slider(2, range=0..10),
    YWAVELOCATION=Slider(50, range=0..100),
    Tile01Colour=ColourSwatch(SwatchColor=RGB(212, 38, 38)),
    Tile02Colour=ColourSwatch(SwatchColor=RGB(187, 222, 33)),
    TileEmpty=ColourSwatch(SwatchColor=RGB(245, 245, 245)))  # -> WaveHalfSurfaces, WaveFullSurfaces, WaveEmptySurfaces, Colours, Uncollapsed
